# Grasshopper definition lofted polygons.gh (Grasshopper 1.0.8)

number_of_polygons = Slider(3, range=1..10)
distance_between_polygons = Slider(3.023, range=0..20)
base_polygon_side_count = Slider(4, range=3..10)
polygon_side_count_step = Slider(1, range=0..10)
flare_amount = Slider(0.679, range=0.001..20)
base_radius = Slider(0.125, range=0.001..20)
extrusion_depth = Slider(0.25, range=0..20)
series = Series(Start=0, Step=distance_between_polygons, Count=number_of_polygons)
lng = ListLength(List=series)
subtraction = Subtraction(A=lng, B=1)
base_fillet_radius = Slider(0, range=0..1)
fillet_radius_step = Slider(0, range=0..1)
pt = ConstructPoint(XCoordinate=0, YCoordinate=0, ZCoordinate=series)
series_2 = Series(Start=base_radius, Step=flare_amount, Count=number_of_polygons)
twist_angle = Slider(1.13, range=0..20)
item = ListItem(List=series, Index=subtraction, Wrap=True)
xy = XYPlane(Origin=pt)
series_3 = Series(Start=base_polygon_side_count, Step=polygon_side_count_step, Count=number_of_polygons)
polygon = Polygon(Plane=xy, Radius=series_2, Segments=series_3, FilletRadius=0)  # -> Polygon, Length
series_4 = Series(Start=base_fillet_radius, Step=fillet_radius_step, Count=number_of_polygons)
pt_2 = ConstructPoint(XCoordinate=0, YCoordinate=0, ZCoordinate=item)
pt_3 = ConstructPoint(XCoordinate=0, YCoordinate=0, ZCoordinate=0)
addition = Addition(A=series_2, B=extrusion_depth)
fillet = Fillet(Curve=polygon.Polygon, Radius=series_4)
ln = Line(StartPoint=pt_3, EndPoint=pt_2)
polygon_2 = Polygon(Plane=xy, Radius=addition, Segments=series_3, FilletRadius=0)  # -> Polygon, Length
loft = Loft(Curves=fillet, Options={Adjust=False, Closed=False, LoftEnds=0, LoftSimp=0, LoftType=0, Rebuild=10, Refit=0.01})
fillet_2 = Fillet(Curve=polygon_2.Polygon, Radius=series_4)
lng_2 = ListLength(List=series)
X = UnitX(Factor=Slider(7.719, range=0..10))
loft_2 = Loft(Curves=fillet_2, Options={Adjust=False, Closed=False, LoftEnds=0, LoftSimp=0, LoftType=0, Rebuild=10, Refit=0.01})
twist = Twist(Geometry=loft, Axis=ln, Angle=twist_angle, Infinite=False, Rigid=False)
subtraction_2 = Subtraction(A=lng_2, B=1)
twist_2 = Twist(Geometry=loft_2, Axis=ln, Angle=twist_angle, Infinite=False, Rigid=False)
material_thickness = Slider(0.5, range=0.001..2)
item_2 = ListItem(List=series, Index=subtraction_2, Wrap=True)
division = Division(A=item_2, B=material_thickness)
addition_2 = Addition(A=division, B=1)
series_5 = Series(Start=0, Step=material_thickness, Count=addition_2)
lng_3 = ListLength(List=series_5)
series_6 = Series(Start=0, Step=1, Count=lng_3)
mod = Modulus(A=series_6, B=10)
panel = Panel(series_5)
brep = Brep(twist)
brep_2 = Brep(twist_2)
pt_4 = ConstructPoint(XCoordinate=0, YCoordinate=0, ZCoordinate=series_5)
xy_2 = XYPlane(Origin=pt_4)
polygon_3 = Polygon(Plane=xy_2, Radius=20, Segments=4, FilletRadius=0)  # -> Polygon, Length
bbx = BrepBrep(BrepA=brep_2, BrepB=polygon_3.Polygon)  # -> Curves, Points
brep_3 = Brep(bbx.Curves)
bbx_2 = BrepBrep(BrepA=brep, BrepB=polygon_3.Polygon)  # -> Curves, Points
brep_4 = Brep(bbx_2.Curves)
sdiff = SolidDifference(BrepsA=brep_3, BrepsB=brep_4)
unflatten = UnflattenTree(Tree=mod, Guide=sdiff)
panel_2 = Panel(unflatten)
textsrf = TextOnSurface(Text=unflatten, Font="Sans Bold:no Italic:no", Height=0.15, Depth=0.01, BaseLine=bbx.Curves, BaseSurface=sdiff)
brep_5 = Brep(textsrf)
rotate = Rotate(Geometry=textsrf, Angle=Slider(0.1, range=0.1..10), Plane=PlaneXY(0, 0, 0))  # -> Geometry, Transform
bbox = BoundingBox(Content=brep_5, Plane=PlaneXY(0, 0, 0))  # -> Box, Box_2
area = Area(Geometry=bbox.Box)  # -> Area, Centroid
pdecon = Deconstruct(Point=area.Centroid)  # -> XComponent, YComponent, ZComponent
pt_5 = ConstructPoint(XCoordinate=0, YCoordinate=0, ZCoordinate=pdecon.ZComponent)
pt_6 = ConstructPoint(XCoordinate=pdecon.XComponent, YCoordinate=pdecon.YComponent, ZCoordinate=pdecon.ZComponent)
vec2pt = Vector2Pt(PointA=pt_6, PointB=pt_5, Unitize=True)  # -> Vector, Length
multiplication = Multiplication(A=vec2pt.Vector, B=Slider(0.113, range=0..1))
move = Move(Geometry=textsrf, Motion=multiplication)  # -> Geometry, Transform
bbx_3 = BrepBrep(BrepA=move.Geometry, BrepB=polygon_3.Polygon)  # -> Curves, Points
bbox_2 = BoundingBox(Content=bbx_3.Curves, Plane=PlaneXY(0, 0, 0))  # -> Box, Box_2
area_2 = Area(Geometry=bbox_2.Box)  # -> Area, Centroid
spacing = Slider(1.422, range=-0.001..20)
neg = Negative(Value=area_2.Centroid)
multiplication_2 = Multiplication(A=spacing, B=2)
flatten = FlattenTree(Tree=bbx.Curves, Path="{0}")
pdecon_2 = Deconstruct(Point=flatten(area_2.Centroid))  # -> XComponent, YComponent, ZComponent
flatten_2 = FlattenTree(Tree=bbx_2.Curves, Path="{0}")
pcen = PolygonCenter(Polyline=bbx.Curves)  # -> CenterV, CenterE, CenterA
pcen_2 = PolygonCenter(Polyline=bbx_2.Curves)  # -> CenterV, CenterE, CenterA
lng_4 = ListLength(List=flatten)
lng_5 = ListLength(List=flatten_2)
neg_2 = Negative(Value=pcen.CenterV)
pt_7 = ConstructPoint(XCoordinate=pdecon_2.ZComponent, YCoordinate=0, ZCoordinate=0)
neg_3 = Negative(Value=pcen_2.CenterV)
pdecon_3 = Deconstruct(Point=neg)  # -> XComponent, YComponent, ZComponent
spacing_exponent = Slider(1.291, range=1..2)
pdecon_4 = Deconstruct(Point=neg_2)  # -> XComponent, YComponent, ZComponent
pt_8 = ConstructPoint(XCoordinate=0, YCoordinate=0, ZCoordinate=pdecon_3.ZComponent)
series_7 = Series(Start=0, Step=spacing, Count=lng_4)
pdecon_5 = Deconstruct(Point=neg_3)  # -> XComponent, YComponent, ZComponent
multiplication_3 = Multiplication(A=pt_7, B=multiplication_2)
series_8 = Series(Start=0, Step=spacing, Count=lng_5)
pt_9 = ConstructPoint(XCoordinate=0, YCoordinate=0, ZCoordinate=pdecon_4.ZComponent)
pow = Power(A=series_7, B=spacing_exponent)
move_2 = Move(Geometry=bbx_3.Curves, Motion=pt_8)  # -> Geometry, Transform
pt_10 = ConstructPoint(XCoordinate=0, YCoordinate=0, ZCoordinate=pdecon_5.ZComponent)
pow_2 = Power(A=series_8, B=spacing_exponent)
move_3 = Move(Geometry=bbx.Curves, Motion=pt_9)  # -> Geometry, Transform
pow_3 = Power(A=multiplication_3, B=spacing_exponent)
pt_11 = ConstructPoint(XCoordinate=pow, YCoordinate=0, ZCoordinate=0)
move_4 = Move(Geometry=bbx_2.Curves, Motion=pt_10)  # -> Geometry, Transform
unflatten_2 = UnflattenTree(Tree=pt_11, Guide=neg_2)
unflatten_3 = UnflattenTree(Tree=pow_3, Guide=area_2.Centroid)
pt_12 = ConstructPoint(XCoordinate=pow_2, YCoordinate=0, ZCoordinate=0)
move_5 = Move(Geometry=move_3.Geometry, Motion=unflatten_2)  # -> Geometry, Transform
move_6 = Move(Geometry=move_2.Geometry, Motion=unflatten_3)  # -> Geometry, Transform
unflatten_4 = UnflattenTree(Tree=pt_12, Guide=neg_3)
move_7 = Move(Geometry=move_4.Geometry, Motion=unflatten_4)  # -> Geometry, Transform
